# Grasshopper definition norm to surface.gh (Grasshopper 1.0.4)

crv = Curve([<curve referenced from the Rhino model> x3])
loft = Loft(Curves=crv, Options={Adjust=False, Closed=False, LoftEnds=0, LoftSimp=0, LoftType=0, Rebuild=10, Refit=0.01})
pt = ConstructPoint(XCoordinate=Slider(0.52, range=0..1), YCoordinate=Slider(0.26, range=0..1), ZCoordinate=0)
evalsrf = EvaluateSurface(Surface=reparameterize(loft), Point=pt)  # -> Point, Normal, UDirection, VDirection, Frame
multiplication = Multiplication(A=evalsrf.Normal, B=Slider(100, range=-100..100))
addition = Addition(A=evalsrf.Point, B=multiplication)
ln = Line(StartPoint=evalsrf.Point, EndPoint=addition)
pipe = Pipe(Curve=ln, Radius=Slider(6, range=0..50), Caps=0)
