# Grasshopper definition random-height collumns built on the division vertices along curve.gh (Grasshopper 1.0.4)

number_slider = Slider(1, range=0..5)
crv = Curve(<curve referenced from the Rhino model>)
divlength = DivideLength(Curve=crv, Length=Slider(3, range=0..5))  # -> Points, Tangents, Parameters
domain = Domain([Slider(10, range=0..20), Slider(2, range=0..20)])
lng = ListLength(List=divlength.Points)
random = Random(Range=domain, Number=lng, Seed=Slider(3, range=0..5))
hframe = HorizontalFrame(Curve=crv, Parameter=divlength.Parameters)
box = DomainBox(Base=hframe, X=number_slider, Y=number_slider, Z=random)
