# Grasshopper definition random-height extrusions with color.gh (Grasshopper 1.0.4)

crv = Curve([<curve referenced from the Rhino model> x7])
dom = ConstructDomain(DomainStart=Slider(13, range=0..100), DomainEnd=Slider(67, range=0..100))
lng = ListLength(List=crv)
random = Random(Range=dom, Number=lng, Seed=Slider(10, range=0..10))
Z = UnitZ(Factor=random)
extr = Extrude(Base=crv, Direction=Z)
cap = CapHoles(Brep=extr)
panel = Panel(cap)
wheel = ColourWheel(
    lng,
    ColourGrips_Style=31,
    ColourGrips_Grip=[5.511915663, 1.323125458, 3.417520561, 2.105448943],
    ColourGrips_Lum=[0.5628071075, 0.8564851542],
    ColourGrips_Range=[0.8629904562, 0.8629904562, 0.8629904562, 0.8629904562],
    ColourGrips_Sat=[0.08454603767, 0.3446947783])
item = ListItem(List=cap, Index=Slider(0, range=0..7), Wrap=True)
item_2 = ListItem(List=cap, Index=Slider(1, range=0..7), Wrap=True)
item_3 = ListItem(List=cap, Index=Slider(2, range=0..7), Wrap=True)
item_4 = ListItem(List=cap, Index=Slider(3, range=0..7), Wrap=True)
item_5 = ListItem(List=cap, Index=Slider(5, range=0..7), Wrap=True)
item_6 = ListItem(List=cap, Index=Slider(4, range=0..7), Wrap=True)
item_7 = ListItem(List=cap, Index=Slider(6, range=0..7), Wrap=True)
preview = CustomPreview(Geometry=[item_5, item_7, item_6, item_4, item_3, item_2, item], Material=wheel)
