# Grasshopper definition sin_curve_surface.gh (Grasshopper 1.0.4)

pi = Pi(Factor=4)
range = Range(Domain=pi, Steps=29)
pt = ConstructPoint(XCoordinate=range, YCoordinate=expr("sin(x)", range), ZCoordinate=0)
intcrv = Interpolate(Vertices=pt, Degree=3, Periodic=False, KnotStyle=1)  # -> Curve, Length, Domain
Z = UnitZ(Factor=1)
extr = Extrude(Base=intcrv.Curve, Direction=Z)
