# Grasshopper definition sine curves loft.gh (Grasshopper 1.0.4)

dom = ConstructDomain(DomainStart=Slider(0.941, range=0..20), DomainEnd=Slider(10.706, range=0..20))
range = Range(Domain=Slider(12, range=0..20), Steps=Slider(50, range=0..50))
range_2 = Range(Domain=dom, Steps=Slider(50, range=0..50))
multiplication = Multiplication(A=range, B=Slider(0.82, range=0..5))
multiplication_2 = Multiplication(A=range_2, B=Slider(1.582, range=0..5))
sin = Sine(Value=multiplication_2)
sin_2 = Sine(Value=multiplication)
multiplication_3 = Multiplication(A=sin_2, B=Slider(3.588, range=0..5))
multiplication_4 = Multiplication(A=range, B=Slider(2.215, range=0..5))
multiplication_5 = Multiplication(A=sin, B=Slider(1.296, range=0..5))
multiplication_6 = Multiplication(A=range_2, B=Slider(2.071, range=0..5))
pt = ConstructPoint(XCoordinate=multiplication_4, YCoordinate=0, ZCoordinate=multiplication_3)
pt_2 = ConstructPoint(XCoordinate=multiplication_6, YCoordinate=0, ZCoordinate=multiplication_5)
Y = UnitY(Factor=Slider(12, range=0..20))
move = Move(Geometry=pt_2, Motion=Y)  # -> Geometry, Transform
ln = Line(StartPoint=pt, EndPoint=move.Geometry)
loft = Loft(Curves=ln, Options={Adjust=False, Closed=False, LoftEnds=0, LoftSimp=0, LoftType=0, Rebuild=10, Refit=0.01})
