# Grasshopper definition surface division with edges points normals.gh (Grasshopper 1.0.4)

number_slider = Slider(10, range=0..30)
number_slider_2 = Slider(10, range=0..30)
crv = Curve([<curve referenced from the Rhino model> x3])
loft = Loft(Curves=crv, Options={Adjust=False, Closed=False, LoftEnds=0, LoftSimp=0, LoftType=0, Rebuild=10, Refit=0.01})
divide = DivideDomain²(Domain=loft, UCount=number_slider, VCount=number_slider_2)
subsrf = Isotrim(Surface=loft, Domain=divide)
multiplication = Multiplication(A=number_slider, B=number_slider_2)
explode = Explode(Curve=subsrf, Recursive=True)  # -> Segments, Vertices
sdivide = DivideSurface(Surface=subsrf, UCount=1, VCount=1)  # -> Points, Normals, Parameters
panel = Panel(sdivide.Points)
series = Series(Start=0, Step=4, Count=multiplication)
series_2 = Series(Start=3, Step=4, Count=multiplication)
flatten = FlattenTree(Tree=sdivide.Points, Path="{0}")
dom = ConstructDomain(DomainStart=series, DomainEnd=series_2)
panel_2 = Panel(flatten)
panel_3 = Panel(dom)
viewer = ParamViewer(flatten)
panel_4 = Panel("new version")
subset = SubList(List=flatten, Domain=dom, Wrap=True)  # -> List, Index
viewer_2 = ParamViewer(subset.List)
item = ListItem(List=subset.List, Index=0, Wrap=True)
item_2 = ListItem(List=subset.List, Index=1, Wrap=True)
item_3 = ListItem(List=subset.List, Index=3, Wrap=True)
item_4 = ListItem(List=subset.List, Index=2, Wrap=True)
panel_5 = Panel(subset.List)
pline = PolyLine(Vertices=[item_4, item], Closed=False)
pline_2 = PolyLine(Vertices=[item_3, item_4], Closed=False)
