# Grasshopper definition topview of trees with ramdom branches and rotation angles based on points.gh (Grasshopper 1.0.4)

number_slider = Slider(36, range=0..36)
int = Integer(2)
pt = Point([<point referenced from the Rhino model> x8])
expression = Expression(x=number_slider, Expression="x/12")
expression_2 = Expression(x=int, Expression="x*π")
random = Random(Range=Domain(0, 1), Number=Slider(10, range=0..36), Seed=Slider(4, range=0..36))
dom = ConstructDomain(DomainStart=0, DomainEnd=expression_2)
cir = Circle(Plane=pt, Radius=expression)
cir_2 = Circle(Plane=pt, Radius=number_slider)
lng = ListLength(List=pt)
random_2 = Random(Range=dom, Number=lng, Seed=Slider(14, range=0..36))
rotate = Rotate(Geometry=cir_2, Angle=random_2, Plane=pt)  # -> Geometry, Transform
rotate_2 = Rotate(Geometry=cir, Angle=random_2, Plane=pt)  # -> Geometry, Transform
eval = EvaluateLength(Curve=graft(rotate.Geometry), Length=random, Normalized=True)  # -> Point, Tangent, Parameter
eval_2 = EvaluateLength(Curve=graft(rotate_2.Geometry), Length=random, Normalized=True)  # -> Point, Tangent, Parameter
ln = Line(StartPoint=eval.Point, EndPoint=eval_2.Point)
crv = Curve([ln, cir_2, cir])
divide = DivideCurve(Curve=<geometry referenced from the Rhino model>, Count=Slider(2, range=0..10), Kinks=False)  # -> Points, Tangents, Parameters
divide_2 = DivideCurve(Curve=<geometry referenced from the Rhino model>, Count=Slider(6, range=0..10), Kinks=False)  # -> Points, Tangents, Parameters
panel = Panel(divide.Points)
panel_2 = Panel(divide_2.Points)
ln_2 = Line(StartPoint=divide.Points, EndPoint=graft(divide_2.Points))
